# Grasshopper definition Process Path Planning.gh (Grasshopper 1.0.7)

reload_process_from_disk = Button()
panel = Panel("PostProcess")
process_path = GhPythonScript()  # -> path
# ---------- process_path: Python ----------
from Rhino.RhinoDoc import ActiveDoc
import os
path = os.path.splitext(ActiveDoc.Path)[0] + "_postprocess.json"
print path
# ---------- end process_path ----------
file_path = FilePath(process_path)
json_unpickle = GhPythonScript(path=file_path, enable=True, reload=reload_process_from_disk)  # -> warn_col, warn_msg, data; inputs enable: Boolean
# ---------- json_unpickle: Python ----------
import jsonpickle
import os
import datetime
if enable and not reload:
    exist = os.path.exists(path)
    if exist:
        with open(path, 'r') as f:
            data = jsonpickle.decode(f.read(), keys=True)
        c_time = datetime.datetime.fromtimestamp(os.path.getmtime(path))
        warn_col = "lime"
        warn_msg = "Process File loaded with %s Beams, %s Clamps, %s Grippers.\n File Modified on %s." % (len(list(data.assembly.beams())), len(list(data.clamps)), len(list(data.grippers)), c_time)
    else:
        warn_col = "orange"    
        warn_msg = "Process File not created yet"
# ---------- end json_unpickle ----------
legend = Legend(Colour=json_unpickle.warn_col, Tags=json_unpickle.warn_msg, LegendType=2)
process = Data(json_unpickle.data)

tool_definition_file_location = Panel("tools/TC2.json")
load_tool = LoadTool(filename=tool_definition_file_location)  # -> warn_col, warn_msg, tool_2
legend_2 = Legend(Colour=load_tool.warn_col, Tags=load_tool.warn_msg, LegendType=2)
python = GhPythonScript(process=process, toolchanger=load_tool.tool_2, activate=Button())  # -> out, process_out
# ---------- python: Python ----------
process_out = process

if activate:
    process.robot_toolchanger = toolchanger
# ---------- end python ----------

# ----
# Save Edits
save_process_to_disk = Button()
json_pickle = GhPythonScript(stuff=python.process_out, path=file_path, output=save_process_to_disk)  # -> out; inputs output: Boolean
# ---------- json_pickle: Python ----------
import integral_timber_joints
from integral_timber_joints.process import RobotClampAssemblyProcess

if output:
    import jsonpickle
    json_str = jsonpickle.encode(stuff, keys= True)
    print ("out json_str len:" , len(json_str))
    with open(path, 'w') as f:
        f.write(json_str)
# ---------- end json_pickle ----------

# ----
# - Update PG 500 and PG1000
# - Update TC1 to TC2
# - Change visualization to transformed location
show_environment_meshes = BooleanToggle(False)
process_environment_meshes = GhPythonScript(process=process, enable=show_environment_meshes)  # -> out, environment_meshes
# ---------- process_environment_meshes: Python ----------
from Rhino.Geometry import Mesh as RhinoMesh
from compas_ghpython.helpers import mesh_draw

environment_meshes = []
if enable:
    for mesh in process.environment_meshes:
        environment_meshes.append(mesh_draw(mesh))
# ---------- end process_environment_meshes ----------

beam_s = Slider(11, range=1..40)
process_2 = Data(process)
python_2 = GhPythonScript(process=process_2)  # -> out, beam_ids, beam_seq_ids
# ---------- python_2: Python ----------
beam_ids = [b for b in process.assembly.sequence]
beam_seq_ids = ["S%i"%(i+1) for i in range(len(process.assembly.sequence))]
# ---------- end python_2 ----------
paths_to_be_planned = Panel("""'assembly_wcf_storage'		-> 'assembly_wcf_inclampapproach'
'assembly_wcf_inclampapproach' 	-> 'assembly_wcf_inclamp'
'assembly_wcf_inclamp'		-> 'assembly_wcf_final'
'assembly_wcf_final'		-> 'assembly_wcf_finalretract'
'assembly_wcf_finalretract'	-> 'assembly_wcf_storage'""")
item = ListItem(List=python_2.beam_ids, Index=expr("x-1", beam_s), Wrap=True)
item_2 = ListItem(List=python_2.beam_seq_ids, Index=expr("x-1", beam_s), Wrap=True)

# ---- group: Pickup location full configuration
externalaxes = Data([22739.00781, -4556.088379, -3555.848633, 0, 0, 0])
robotjoints = Data([-1.396026134, -22.83474159, -30.71155357, 0.5938810706, 57.33565521, 0.009398107417])
pickup_frame_plane_read_from_wobj0_tool0 = Plane(Plane(origin=(23237.50586, 4567.052246, 935.100708), x=(-0.06596095582, -0.007370644881, 0.9977949819), y=(0.01603430264, -0.9998514313, -0.006325860542)))
robotjoints_2 = Panel(robotjoints)
external_axis = Panel(externalaxes)

# ----
panel_2 = Panel(item_2)
panel_3 = Panel(item)
visualize_beams_grippers = GhPythonScript(process=process_2)  # -> out, previous_beams, current_beam, gripper; inputs previous_beams_color: Color, current_beam_color: Color; disabled
# ---------- visualize_beams_grippers: Python ----------
__author__ = "leungp"
__version__ = "2020.02.19"

from compas_ghpython.helpers import mesh_draw
from compas.geometry import Transformation
from compas.datastructures import meshes_join

from Rhino.Geometry import Mesh as RhinoMesh
assembly = process.assembly

# If user has no selection, assume the last beam is picked.
if beam_id is None: beam_id = assembly.sequence[-1]

##########################
# Previous Beams
##########################

# Collect the previously-assembled beam(s)
previous_beams = []

for this_beam_id in assembly.get_already_built_beams(beam_id):
    beam = assembly.beam(this_beam_id)
    previous_beams.append(mesh_draw(beam.cached_mesh, color = previous_beams_color))

###################################
# Current Beam (Different Location)
###################################

# Select the current beam
beam = assembly.beam(beam_id)

# Translate the beam to various location and display
current_beam = []
current_beam_assembly_wcf_final = mesh_draw(beam.cached_mesh, color = current_beam_color)

def join_meshes(meshes):
    if len(meshes) == 1 : return meshes [0]
    

def draw_beam_at(attribute_name):
    T = assembly.get_beam_transformaion_to(beam_id, attribute_name)
    if T is not None:
        current_beam.append(mesh_draw(beam.cached_mesh.transformed(T), color = current_inclamp_color))
    else: current_beam.append(None)

draw_beam_at('assembly_wcf_storage') # Beam does not go to 'assembly_wcf_storageapproach'
draw_beam_at('assembly_wcf_storage')
draw_beam_at('assembly_wcf_storageretract')
if assembly.get_beam_attribute(beam_id, 'assembly_wcf_inclampapproach') is not None:
    draw_beam_at('assembly_wcf_inclampapproach')
else:
    draw_beam_at('assembly_wcf_inclamp')
draw_beam_at('assembly_wcf_inclamp')
draw_beam_at('assembly_wcf_final')
draw_beam_at('assembly_wcf_final') # Beam does not go to 'assembly_wcf_finalretract'

###################################
# Clamps (multiple clamps)
###################################

clamps = []
# Visualize clamps
for neighbour_id in assembly.get_already_built_neighbors(beam_id):
    joint_id = (neighbour_id, beam_id)
    clamp_wcf_final = assembly.get_joint_attribute(joint_id, 'clamp_wcf_final')
    print (clamp_wcf_final)
    clamp_type = assembly.get_joint_attribute(joint_id, 'clamp_type')
    clamp = process.get_one_clamp_by_type(clamp_type).copy()
    clamp.set_current_frame_from_tcp(clamp_wcf_final)
    clamp.clamp_jaw_position = 120
    clamp.gripper_jaw_position = 0
    clamps.append(clamp)
    print (clamp)
    

###################################
# Gripper (Different Location)
###################################

gripper = []
# Get Gripper and move it to the beam's frame
gripper_type = assembly.get_beam_attribute(beam_id, 'gripper_type')
_gripper = process.get_one_gripper_by_type(gripper_type)

#gripper_tcp_in_ocf = assembly.get_beam_attribute(beam_id, "gripper_tcp_in_ocf")
#gripper_tcp_in_wcf = gripper_tcp_in_ocf.transformed(Transformation.from_frame(beam.frame))

def draw_gripper_at(attribute_name, gripper_open = True, mesh_join_by_rhino = True):
    gripper_t0cp = process.get_gripper_t0cp_for_beam_at(beam_id, attribute_name)
    if gripper_t0cp is not None:
        _gripper.current_frame = gripper_t0cp
        if gripper_open: _gripper.open_gripper()
        else: _gripper.close_gripper()
        # Two different way to join meshes
        if mesh_join_by_rhino:
            joinedMesh = RhinoMesh()
            meshes = [joinedMesh.Append(mesh_draw(m,  color = gripper_color)) for m in _gripper.draw_visuals()]
            gripper.append(joinedMesh)
        else:
            meshes = meshes_join(_gripper.draw_visuals())
            gripper.append(mesh_draw(meshes,  color = gripper_color))
        
    else: gripper.append(None)
    
draw_gripper_at('assembly_wcf_storageapproach', True)
draw_gripper_at('assembly_wcf_storage', True)
draw_gripper_at('assembly_wcf_storageretract', False)
if assembly.get_beam_attribute(beam_id, 'assembly_wcf_inclampapproach') is not None:
    draw_gripper_at('assembly_wcf_inclampapproach', False)
else:
    draw_gripper_at('assembly_wcf_inclamp', False)
draw_gripper_at('assembly_wcf_inclamp', False)
draw_gripper_at('assembly_wcf_final', False)
draw_gripper_at('assembly_wcf_finalretract', True)
# ---------- end visualize_beams_grippers ----------
visualize_beams = GhPythonScript(process=process_2, beam_id=item)  # -> out, previous_beams, current_beam, gripper; inputs previous_beams_color: Color, current_beam_color: Color
# ---------- visualize_beams: Python ----------
__author__ = "leungp"
__version__ = "2020.02.19"

from compas_ghpython.helpers import mesh_draw
from compas.geometry import Transformation
from compas.datastructures import meshes_join

from Rhino.Geometry import Mesh as RhinoMesh
assembly = process.assembly

# If user has no selection, assume the last beam is picked.
if beam_id is None: beam_id = assembly.sequence[-1]

##########################
# Previous Beams
##########################

# Collect the previously-assembled beam(s)
previous_beams = []

for this_beam_id in assembly.get_already_built_beams(beam_id):
    beam = assembly.beam(this_beam_id)
    previous_beams.append(mesh_draw(beam.cached_mesh, color = previous_beams_color))

###################################
# Current Beam (Different Location)
###################################

# Select the current beam
beam = assembly.beam(beam_id)

# Translate the beam to various location and display
current_beam = []
current_beam_assembly_wcf_final = mesh_draw(beam.cached_mesh, color = current_beam_color)

def join_meshes(meshes):
    if len(meshes) == 1 : return meshes [0]
    

def draw_beam_at(attribute_name):
    T = assembly.get_beam_transformaion_to(beam_id, attribute_name)
    if T is not None:
        current_beam.append(mesh_draw(beam.cached_mesh.transformed(T), color = current_inclamp_color))
    else: current_beam.append(None)

###################################
# Clamps (multiple clamps)
###################################

clamps = []
# Visualize clamps
for neighbour_id in assembly.get_already_built_neighbors(beam_id):
    joint_id = (neighbour_id, beam_id)
    clamp_wcf_final = assembly.get_joint_attribute(joint_id, 'clamp_wcf_final')
    print (clamp_wcf_final)
    clamp_type = assembly.get_joint_attribute(joint_id, 'clamp_type')
    clamp = process.get_one_clamp_by_type(clamp_type).copy()
    clamp.set_current_frame_from_tcp(clamp_wcf_final)
    clamp.clamp_jaw_position = 120
    clamp.gripper_jaw_position = 0
    clamps.append(clamp)
    print (clamp)
    

###################################
# Gripper (Different Location)
###################################

gripper = []
# Get Gripper and move it to the beam's frame
gripper_type = assembly.get_beam_attribute(beam_id, 'gripper_type')
_gripper = process.get_one_gripper_by_type(gripper_type)

#gripper_tcp_in_ocf = assembly.get_beam_attribute(beam_id, "gripper_tcp_in_ocf")
#gripper_tcp_in_wcf = gripper_tcp_in_ocf.transformed(Transformation.from_frame(beam.frame))

def draw_gripper_at(attribute_name, gripper_open = True, mesh_join_by_rhino = True):
    gripper_t0cp = process.get_gripper_t0cp_for_beam_at(beam_id, attribute_name)
    if gripper_t0cp is not None:
        _gripper.current_frame = gripper_t0cp
        if gripper_open: _gripper.open_gripper()
        else: _gripper.close_gripper()
        # Two different way to join meshes
        if mesh_join_by_rhino:
            joinedMesh = RhinoMesh()
            meshes = [joinedMesh.Append(mesh_draw(m,  color = gripper_color)) for m in _gripper.draw_visuals()]
            gripper.append(joinedMesh)
        else:
            meshes = meshes_join(_gripper.draw_visuals())
            gripper.append(mesh_draw(meshes,  color = gripper_color))
        
    else: gripper.append(None)





draw_beam_at('assembly_wcf_storage') # Beam does not go to 'assembly_wcf_storageapproach'
draw_gripper_at('assembly_wcf_storageapproach', True)


draw_beam_at('assembly_wcf_storage')
draw_beam_at('assembly_wcf_storageretract')
if assembly.get_beam_attribute(beam_id, 'assembly_wcf_inclampapproach') is not None:
    draw_beam_at('assembly_wcf_inclampapproach')
else:
    draw_beam_at('assembly_wcf_inclamp')
draw_beam_at('assembly_wcf_inclamp')
draw_beam_at('assembly_wcf_final')
draw_beam_at('assembly_wcf_final') # Beam does not go to 'assembly_wcf_finalretract'




draw_gripper_at('assembly_wcf_storage', True)
draw_gripper_at('assembly_wcf_storageretract', False)
if assembly.get_beam_attribute(beam_id, 'assembly_wcf_inclampapproach') is not None:
    draw_gripper_at('assembly_wcf_inclampapproach', False)
else:
    draw_gripper_at('assembly_wcf_inclamp', False)
draw_gripper_at('assembly_wcf_inclamp', False)
draw_gripper_at('assembly_wcf_final', False)
draw_gripper_at('assembly_wcf_finalretract', True)
# ---------- end visualize_beams ----------
flange_pos_in_robworld = GhPythonScript(process=process_2, beam_id=item)  # -> out, assembly_wcf_final, a
# ---------- flange_pos_in_robworld: Python ----------
from compas.geometry import Frame
from compas_ghpython import draw_frame

assembly = process.assembly
gripper_type = assembly.get_beam_attribute(beam_id, 'gripper_type')
gripper = process.get_one_gripper_by_type(gripper_type)

toolchanger = process.robot_toolchanger


def flange_frame_at(attribute_name):
    gripper_t0cp = process.get_gripper_t0cp_for_beam_at(beam_id, attribute_name)
    toolchanger.set_current_frame_from_tcp(gripper_t0cp)
    return toolchanger.current_frame.copy()



assembly_wcf_final =  draw_frame(flange_frame_at('assembly_wcf_final'))
# ---------- end flange_pos_in_robworld ----------
collision_mesh_attached_clamps = Mesh()
collision_mesh_already_built_beams = Mesh()
planning_group = Panel("Rob21XYZ")
attached_mesh_beam_in_gripper = Mesh()
attached_mesh_gripper = Mesh()
attached_mesh_toolchangerwithipgsflange = Mesh()
collision_mesh_static = Mesh()
pln_starting_plane = Plane()
pln_ending_plane = Plane()

# ==== cluster LoadTool
filename = ClusterInput()
auto_path = GhPythonScript(filename=filename)  # -> json_path
# ---------- auto_path: Python ----------
from Rhino.RhinoDoc import ActiveDoc
import os
json_path = os.path.dirname(ActiveDoc.Path) + os.sep + filename
# ---------- end auto_path ----------
json_unpickle_mesh = GhPythonScript(path=auto_path, enable=True)  # -> warn_col, warn_msg, data; inputs enable: Boolean
# ---------- json_unpickle_mesh: Python ----------
import jsonpickle
import os
import datetime
if enable:
    exist = os.path.exists(path)
    if exist:
        with open(path, 'r') as f:
            data = jsonpickle.decode(f.read(), keys=True)
        c_time = datetime.datetime.fromtimestamp(os.path.getmtime(path))
        warn_col = "lime"
        warn_msg = "%s Object loaded.\n File Modified on %s." % (data.__class__.__name__, c_time)
    else:
        warn_col = "orange"    
        warn_msg = "Tool File not exist"
# ---------- end json_unpickle_mesh ----------
warn_col = ClusterOutput(json_unpickle_mesh.warn_col)
warn_msg = ClusterOutput(json_unpickle_mesh.warn_msg)
tool = Data(json_unpickle_mesh.data)
tool_2 = ClusterOutput(tool)
